# Grasshopper definition RTree.gh (Grasshopper 1.0.8)

pt = Point([Point(-3.342440335, 1.696189433, 0), Point(-2.378912393, 1.913760259, 0), Point(-0.8869981601, 3.188103666, 0), Point(-0.5140196018, 9.062515959, 0), Point(18.15545739, 20.029516, 0), Point(24.00399872, 5.516469002, 0)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])
lng = ListLength(List=pt)
subtraction = Subtraction(A=lng, B=Slider(5, range=0..10))
reduce = RandomReduce(List=pt, Reduction=subtraction, Seed=1)
c_script = CSharpScript(Pts1=pt, Pts2=reduce)  # -> out, IntTree, a; inputs Pts1: list of Point3d, Pts2: list of Point3d
# ---------- c_script: C# ----------
// Grasshopper Script Instance
#region Usings
using System;
using System.Linq;
using System.Collections;
using System.Collections.Generic;
using System.Drawing;

using Rhino;
using Rhino.Geometry;

using Grasshopper;
using Grasshopper.Kernel;
using Grasshopper.Kernel.Data;
using Grasshopper.Kernel.Types;
#endregion

public class Script_Instance : GH_ScriptInstance
{
    #region Notes
    /* 
      Members:
        RhinoDoc RhinoDocument
        GH_Document GrasshopperDocument
        IGH_Component Component
        int Iteration

      Methods (Virtual & overridable):
        Print(string text)
        Print(string format, params object[] args)
        Reflect(object obj)
        Reflect(object obj, string method_name)
    */
    #endregion

    private void RunScript(
		List<Point3d> Pts1,
		List<Point3d> Pts2,
		ref object IntTree,
		ref object a)
    {
        if(Pts1 == null || Pts2 ==null)
            return;
        var DataInt = RTree.Point3dClosestPoints(Pts1, Pts2, 0.01);
        var Tree = new DataTree<int>();
        var Path = 0;
        foreach(var T in DataInt)
        {
            Tree.AddRange(T, new GH_Path(Path));
            Path++;
        }
        IntTree = Tree;
    }
}
# ---------- end c_script ----------
panel = Panel(c_script.IntTree)
item = ListItem(List=pt, Index=c_script.IntTree, Wrap=True)
