# Grasshopper definition Test1.gh (Grasshopper 1.0.8)

number_slider = Slider(10, range=0..10)
number_slider_2 = Slider(3, range=0..10)
Z = UnitZ(Factor="12")
move = Move(Motion=Z)  # -> Geometry, Transform
rotate = Rotate(Angle=degrees(Slider(9, range=0..100)), Plane=PlaneXY(0, 0, 0))  # -> Geometry, Transform
c_script = CSharpScript(Size=number_slider_2)  # -> out, oSLBlockPair; inputs Size: Double
# ---------- c_script: C# ----------
// Grasshopper Script Instance
#region Usings
#r "/Volumes/File/IBOIS/Courses/TimberResearch/SLBlockResearch/Program/VScode/bin/Debug/net7.0/VScode.dll"
using System;
using System.Linq;
using System.Collections;
using System.Collections.Generic;
using System.Drawing;
using Block;
using Rhino;
using Rhino.Geometry;

using Grasshopper;
using Grasshopper.Kernel;
using Grasshopper.Kernel.Data;
using Grasshopper.Kernel.Types;
#endregion

public class Script_Instance : GH_ScriptInstance
{
    #region Notes
    /* 
      Members:
        RhinoDoc RhinoDocument
        GH_Document GrasshopperDocument
        IGH_Component Component
        int Iteration

      Methods (Virtual & overridable):
        Print(string text)
        Print(string format, params object[] args)
        Reflect(object obj)
        Reflect(object obj, string method_name)
    */
    #endregion

    private void RunScript(double Size, ref object oSLBlockPair)
    {
        // Write your logic here
        var SL = new SLBlockPair(Size);
        SL.SetIdenifier("I");
        oSLBlockPair = SL;
    }
}
# ---------- end c_script ----------
c_script_2 = CSharpScript(Size=number_slider_2)  # -> TSStrings; inputs Size: Double
# ---------- c_script_2: C# ----------
// Grasshopper Script Instance
#region Usings
using System;
using System.Linq;
using System.Collections;
using System.Collections.Generic;
using System.Drawing;

using Rhino;
using Rhino.Geometry;

using Grasshopper;
using Grasshopper.Kernel;
using Grasshopper.Kernel.Data;
using Grasshopper.Kernel.Types;
#endregion

public class Script_Instance : GH_ScriptInstance
{
    #region Notes
    /* 
      Members:
        RhinoDoc RhinoDocument
        GH_Document GrasshopperDocument
        IGH_Component Component
        int Iteration

      Methods (Virtual & overridable):
        Print(string text)
        Print(string format, params object[] args)
        Reflect(object obj)
        Reflect(object obj, string method_name)
    */
    #endregion

    private void RunScript(double Size, ref object TSStrings)
    {
        // Write your logic here
        //H T S D A Y
        var TStrings = new List<string>{
            $"{Size * 2} 0 0 180 0 0", 
            $"{Size} {Size} {Size} 180 0 -90",
            $"{Size} {-Size} {-Size}, 0 0 -90",
            $"{Size * 2} 0 {Size} 0 0 0",
            $"{Size} {Size} 0 0 0 -90",
            $"{-Size} {Size} {-2 * Size} 0 0 90"
        };
        TSStrings = TStrings;
    }
    private Transform TSParser(string TText)
    {
        var Num = TText.Split(' ').Select(x => {
            if(!double.TryParse(x, out var Result))
            {
                throw new Exception($"Parsing {x} into number was failed");
            }
            return Result;
        }).ToList();
        if(Num.Count > 6) throw new Exception("Input format error");
        var Vec = new Vector3d(Num[0], Num[1], Num[2]);
        var RotX = Transform.Rotation(Num[4] / 180 * Math.PI, Vector3d.XAxis, Point3d.Origin);
        var RotY = Transform.Rotation(Num[5] / 180 * Math.PI, Vector3d.YAxis, Point3d.Origin);
        var RotZ = Transform.Rotation(Num[6] / 180 * Math.PI, Vector3d.ZAxis, Point3d.Origin);

        return RotX * RotY * RotZ * Transform.Translation(Vec);

    }
}
# ---------- end c_script_2 ----------
c_script_3 = CSharpScript(Size=number_slider_2)  # -> out, oSLBlock; inputs Size: Double
# ---------- c_script_3: C# ----------
// Grasshopper Script Instance
#region Usings
#r "/Volumes/File/IBOIS/Courses/TimberResearch/SLBlockResearch/Program/VScode/bin/Debug/net7.0/VScode.dll"
using System;
using System.Linq;
using System.Collections;
using System.Collections.Generic;
using System.Drawing;
using Block;
using Rhino;
using Rhino.Geometry;

using Grasshopper;
using Grasshopper.Kernel;
using Grasshopper.Kernel.Data;
using Grasshopper.Kernel.Types;
#endregion

public class Script_Instance : GH_ScriptInstance
{
    #region Notes
    /* 
      Members:
        RhinoDoc RhinoDocument
        GH_Document GrasshopperDocument
        IGH_Component Component
        int Iteration

      Methods (Virtual & overridable):
        Print(string text)
        Print(string format, params object[] args)
        Reflect(object obj)
        Reflect(object obj, string method_name)
    */
    #endregion

    private void RunScript(double Size, ref object oSLBlock)
    {
        // Write your logic here
        var SL = new SLBlock(Size);
        SL.SetIdenifier("I");
        oSLBlock = SL;
    }
}
# ---------- end c_script_3 ----------
# I ih1 i_h [ ih2 i_h ] ih1 i_h [ ih2 i_h ] ih1 i_h [ ih2 i_h ] ih1 i_h [ ih2 i_h ]
panel = Panel("I ih1 i_h [ ih2 i_h ] ih1 i_h [ ih2 i_h ] ih1 i_h [ ih2 i_h ] ih1 i_h [ ih2 i_h ]")
c_script_4 = CSharpScript(Name="I")  # -> out, Token; inputs Name: String
# ---------- c_script_4: C# ----------
// Grasshopper Script Instance
#region Usings
#r "/Volumes/File/IBOIS/Courses/TimberResearch/SLBlockResearch/Program/VScode/bin/Debug/net7.0/VScode.dll"
using System;
using System.Linq;
using System.Collections;
using System.Collections.Generic;
using System.Drawing;

using Rhino;
using Rhino.Geometry;

using Block;
using Grammar;

using Grasshopper;
using Grasshopper.Kernel;
using Grasshopper.Kernel.Data;
using Grasshopper.Kernel.Types;
#endregion

public class Script_Instance : GH_ScriptInstance
{
    #region Notes
    /* 
      Members:
        RhinoDoc RhinoDocument
        GH_Document GrasshopperDocument
        IGH_Component Component
        int Iteration

      Methods (Virtual & overridable):
        Print(string text)
        Print(string format, params object[] args)
        Reflect(object obj)
        Reflect(object obj, string method_name)
    */
    #endregion

    private void RunScript(string Name, ref object Token)
    {
        // Write your logic here
        Token = new IDToken(Name, "I");
    }
}
# ---------- end c_script_4 ----------
c_script_5 = CSharpScript(Name="H", TS=move.Transform)  # -> out, Token; inputs Name: String, TS: Transform
# ---------- c_script_5: C# ----------
// Grasshopper Script Instance
#region Usings
#r "/Volumes/File/IBOIS/Courses/TimberResearch/SLBlockResearch/Program/VScode/bin/Debug/net7.0/VScode.dll"
using System;
using System.Linq;
using System.Collections;
using System.Collections.Generic;
using System.Drawing;

using Rhino;
using Rhino.Geometry;
using Grammar;
using Block;
using Grasshopper;
using Grasshopper.Kernel;
using Grasshopper.Kernel.Data;
using Grasshopper.Kernel.Types;
#endregion

public class Script_Instance : GH_ScriptInstance
{
    #region Notes
    /* 
      Members:
        RhinoDoc RhinoDocument
        GH_Document GrasshopperDocument
        IGH_Component Component
        int Iteration

      Methods (Virtual & overridable):
        Print(string text)
        Print(string format, params object[] args)
        Reflect(object obj)
        Reflect(object obj, string method_name)
    */
    #endregion

    private void RunScript(string Name, Transform TS, ref object Token)
    {
        // Write your logic here
        Token = new TransformationToken(Name, TS);
    }
}
# ---------- end c_script_5 ----------
panel_2 = Panel("""12 0 0 0 0 0
-6 0 0 180 0 0
-12 0 0 0 0 0""")
panel_3 = Panel(c_script_2)
panel_4 = Panel("I H I")
c_script_6 = CSharpScript(Name="i_h", t=Slider(1, range=0..1))  # -> out, iTransIDToken, a; inputs Name: String, t: Double
# ---------- c_script_6: C# ----------
// Grasshopper Script Instance
#region Usings
using System;
#r "/Volumes/File/IBOIS/Courses/TimberResearch/SLBlockResearch/Program/VScode/bin/Debug/net7.0/VScode.dll"
using System.Linq;
using System.Collections;
using System.Collections.Generic;
using System.Drawing;
using Block;
using Graph;
using Grammar;
using Rhino;
using Rhino.Geometry;

using Grasshopper;
using Grasshopper.Kernel;
using Grasshopper.Kernel.Data;
using Grasshopper.Kernel.Types;
#endregion

public class Script_Instance : GH_ScriptInstance
{
    #region Notes
    /* 
      Members:
        RhinoDoc RhinoDocument
        GH_Document GrasshopperDocument
        IGH_Component Component
        int Iteration

      Methods (Virtual & overridable):
        Print(string text)
        Print(string format, params object[] args)
        Reflect(object obj)
        Reflect(object obj, string method_name)
    */
    #endregion

    private void RunScript(
		string Name,
		double t,
		ref object iTransIDToken,
		ref object a)
    {
        // Write your logic here

        var TranIDT = new TransIDToken(Name, "I", PairLock);
        TranIDT.SetT(t);
        iTransIDToken = TranIDT;
        a = TranIDT.Name;
    }
    private List<Transform> PairLock(IShapeContext context)
    {
        var S = context.blocks.First().Size;
        var R = Transform.Rotation(Math.PI, Vector3d.ZAxis, Point3d.Origin);
        var T = Transform.Translation(new Vector3d(2*S, 0,0));
        return new List<Transform>{Transform.Identity, R * T};
    }
}

 public sealed class TransIDToken: Token, IsIDToken
 {
    public NodeBase TokenNode {get; private set;}
    public double StabilityCost {get; private set;}
    private double t;
    public override string Name {get;}
    public string Identifier {get;}
    private AdditionalPlacement Add;
    public delegate List<Transform> AdditionalPlacement(IShapeContext context);
    public TransIDToken(string Name, string Identifier, AdditionalPlacement Add)
    {
        t = 0;
        this.Name = Name;
        this.Identifier = Identifier;
        this.Add = Add;
        this.IsCalled = 0;
    }
    public void SetT(double t) => this.t = 1 - t;
    private int IsCalled = 0;
    private List<Color> Cols = new List<Color>{Color.Red, Color.White, Color.Black, Color.Blue};
    public override bool Action(ref IShapeContext context, params object[] args)
    {
        var BList = args.First() as BlockList<IBlockBase>;
        var Pointer = context.PointerTS;
        var PL = Plane.WorldXY;
        PL.Transform(Pointer);
        this.IsCalled++;
        var PlacedVec = PL.ZAxis * context.blocks.First().Size * -4;
        var Col = Cols[IsCalled%4];
        context.shapeInterpreter.cmd += "Move Vector: " + (PlacedVec * t).ToString() + "\n";
        
        var TSVelocity = Transform.Translation( PlacedVec * t);
        var TSAdd = this.Add(context);
        if(context.blocks.Select(x => x.attribute.Identifier).ToList().Contains(this.Identifier))
        {
            
            var ListNode = new List<SNode>();
            
            for(int i = 0; i < TSAdd.Count; i++)
            {
                var GetBlock = context.blocks.Where(b => b.attribute.Identifier == this.Identifier).First().DuplicateBlock();
                GetBlock.Transform(TSVelocity);
                GetBlock.Transform(context.PointerTS);
                GetBlock.Transform(TSAdd[i]);

                BList.Add((IBlockBase)GetBlock);
                BList.Last().attribute.BlockColor = Col;
                ListNode.Add(new SNode(GetBlock, context.GetNodeID()));
            }
            this.TokenNode = new SGNode(context.GetNodeID(), ListNode);
            return true;
        }

        return false;
    }
    public bool SetSNode(ref IShapeContext context, SGraph sGraph, params object[] args)
    {
        if(context.PointerNode == null)
           sGraph.AddNode(this.TokenNode);
        else
           sGraph.AddNode(this.TokenNode, context.PointerNode.ID);
        context.PointerNode = this.TokenNode;
        return true;
    }
    public void SetStabilityCost(ref IShapeContext context)
    {
        this.StabilityCost = 0.66;
    }
 }
# ---------- end c_script_6 ----------
panel_5 = Panel("i_h cap i^h cap_2 i^h")
panel_6 = Panel(c_script_6.a)
panel_7 = Panel("""H
T
S
D
A
Y""")
c_script_7 = CSharpScript(TSStrings=panel_2)  # -> TS; inputs TSStrings: String
# ---------- c_script_7: C# ----------
// Grasshopper Script Instance
#region Usings
using System;
using System.Linq;
using System.Collections;
using System.Collections.Generic;
using System.Drawing;

using Rhino;
using Rhino.Geometry;

using Grasshopper;
using Grasshopper.Kernel;
using Grasshopper.Kernel.Data;
using Grasshopper.Kernel.Types;
#endregion

public class Script_Instance : GH_ScriptInstance
{
    #region Notes
    /* 
      Members:
        RhinoDoc RhinoDocument
        GH_Document GrasshopperDocument
        IGH_Component Component
        int Iteration

      Methods (Virtual & overridable):
        Print(string text)
        Print(string format, params object[] args)
        Reflect(object obj)
        Reflect(object obj, string method_name)
    */
    #endregion

    private void RunScript(string TSStrings, ref object TS)
    {
        // Write your logic here
        TS = TSParser(TSStrings);
    }
    private Transform TSParser(string TText)
    {
        var Num = TText.Split(' ').Select(x => {
            if(!double.TryParse(x, out var Result))
            {
                throw new Exception($"Parsing {x} into number was failed");
            }
            return Result;
        }).ToList();
        if(Num.Count > 6) throw new Exception("Input format error");
        var Vec = new Vector3d(Num[0], Num[1], Num[2]);
        var RotX = Transform.Rotation(Num[3] / 180 * Math.PI, Vector3d.XAxis, Point3d.Origin);
        var RotY = Transform.Rotation(Num[4] / 180 * Math.PI, Vector3d.YAxis, Point3d.Origin);
        var RotZ = Transform.Rotation(Num[5] / 180 * Math.PI, Vector3d.ZAxis, Point3d.Origin);

        return RotX * RotY * RotZ * Transform.Translation(Vec);

    }
}
# ---------- end c_script_7 ----------
c_script_8 = CSharpScript(TSStrings=c_script_2)  # -> TS; inputs TSStrings: String; same code as c_script_7
panel_8 = Panel("""ih1
ih2
ih1^""")
c_script_9 = CSharpScript(Name=panel_8, TS=c_script_7)  # -> out, Token; inputs Name: String, TS: Transform; same code as c_script_5
c_script_10 = CSharpScript(Name=panel_7, TS=c_script_8)  # -> out, Token; inputs Name: String, TS: Transform; same code as c_script_5
c_script_11 = CSharpScript()  # -> out, PushT
# ---------- c_script_11: C# ----------
// Grasshopper Script Instance
#region Usings
#r "/Volumes/File/IBOIS/Courses/TimberResearch/SLBlockResearch/Program/VScode/bin/Debug/net7.0/VScode.dll"
using System;
using System.Linq;
using System.Collections;
using System.Collections.Generic;
using System.Drawing;

using Rhino;
using Rhino.Geometry;
using Grammar;
using Grasshopper;
using Grasshopper.Kernel;
using Grasshopper.Kernel.Data;
using Grasshopper.Kernel.Types;
#endregion

public class Script_Instance : GH_ScriptInstance
{
    #region Notes
    /* 
      Members:
        RhinoDoc RhinoDocument
        GH_Document GrasshopperDocument
        IGH_Component Component
        int Iteration

      Methods (Virtual & overridable):
        Print(string text)
        Print(string format, params object[] args)
        Reflect(object obj)
        Reflect(object obj, string method_name)
    */
    #endregion

    private void RunScript(ref object PushT)
    {
        // Write your logic here
        PushT = new PushToken();
    }
}
# ---------- end c_script_11 ----------
c_script_12 = CSharpScript()  # -> out, PopT
# ---------- c_script_12: C# ----------
// Grasshopper Script Instance
#region Usings
#r "/Volumes/File/IBOIS/Courses/TimberResearch/SLBlockResearch/Program/VScode/bin/Debug/net7.0/VScode.dll"
using System;
using System.Linq;
using System.Collections;
using System.Collections.Generic;
using System.Drawing;

using Rhino;
using Rhino.Geometry;
using Grammar;
using Grasshopper;
using Grasshopper.Kernel;
using Grasshopper.Kernel.Data;
using Grasshopper.Kernel.Types;
#endregion

public class Script_Instance : GH_ScriptInstance
{
    #region Notes
    /* 
      Members:
        RhinoDoc RhinoDocument
        GH_Document GrasshopperDocument
        IGH_Component Component
        int Iteration

      Methods (Virtual & overridable):
        Print(string text)
        Print(string format, params object[] args)
        Reflect(object obj)
        Reflect(object obj, string method_name)
    */
    #endregion

    private void RunScript(ref object PopT)
    {
        // Write your logic here
        PopT = new PopToken();
    }
}
# ---------- end c_script_12 ----------
merge = Merge(
    Data1=c_script_10.Token,
    Data2=c_script_4.Token,
    Data3=c_script_6.iTransIDToken,
    Data4=c_script_9.Token,
    Data5=c_script_12.PopT,
    Data6=c_script_11.PushT)  # -> flatten(Result)
item = ListItem(List=c_script_3.oSLBlock, Index=0, Wrap=True)
Z_2 = UnitZ(Factor=Slider(3, range=0..10))
move_2 = Move(Motion=Z_2)  # -> Geometry, Transform
c_script_13 = CSharpScript(iSLBlock=c_script_3.oSLBlock, Tokens=merge, Sentence="I H i_h H i_h")  # -> out, Blocks, cmd, Inter; inputs Tokens: list, Sentence: String
# ---------- c_script_13: C# ----------
// Grasshopper Script Instance
#region Usings
#r "/Volumes/File/IBOIS/Courses/TimberResearch/SLBlockResearch/Program/VScode/bin/Debug/net7.0/VScode.dll"
using System;
using System.Linq;
using System.Collections;
using System.Collections.Generic;
using System.Drawing;

using Rhino;
using Rhino.Geometry;
using Block;
using Grammar;
using Grasshopper;
using Grasshopper.Kernel;
using Grasshopper.Kernel.Data;
using Grasshopper.Kernel.Types;
#endregion

public class Script_Instance : GH_ScriptInstance
{
    #region Notes
    /* 
      Members:
        RhinoDoc RhinoDocument
        GH_Document GrasshopperDocument
        IGH_Component Component
        int Iteration

      Methods (Virtual & overridable):
        Print(string text)
        Print(string format, params object[] args)
        Reflect(object obj)
        Reflect(object obj, string method_name)
    */
    #endregion

    private void RunScript(
		object iSLBlock,
		List<object> Tokens,
		string Sentence,
		ref object Blocks,
		ref object cmd,
		ref object Inter)
    {
        var SL = (IBlockBase) iSLBlock;
        var Interpret = new ShapeInterpreter(SL);
        foreach(Token T in Tokens)
        {
            Interpret.AddToken(T);
        }
        Interpret.SetSentence(Sentence);
        Interpret.Compute();

        Blocks = Interpret.GetBlockList();
        cmd = Interpret.cmd;
        Inter = Interpret;
    }
}
# ---------- end c_script_13 ----------
panel_9 = Panel(c_script_13.cmd)
c_script_14 = CSharpScript(iSLBlock=c_script_3.oSLBlock, Tokens=merge, Sentence=panel)  # -> out, Blocks, cmd, Inter; inputs Tokens: list, Sentence: String; same code as c_script_13
panel_10 = Panel(c_script_14.cmd)
c_script_15 = CSharpScript(t=Slider(0, range=0..100), y=c_script_14.Inter, Ts=move_2.Transform)  # -> out, a; inputs t: Int32, Ts: Transform
# ---------- c_script_15: C# ----------
// Grasshopper Script Instance
#region Usings
using System;
#r "/Volumes/File/IBOIS/Courses/TimberResearch/SLBlockResearch/Program/VScode/bin/Debug/net7.0/VScode.dll"
using System.Linq;
using System.Collections;
using System.Collections.Generic;
using System.Drawing;
using Graph;
using Grammar;
using ConstraintDOF;
using Rhino;
using Rhino.Geometry;
using Block;
using Grasshopper;
using Grasshopper.Kernel;
using Grasshopper.Kernel.Data;
using Grasshopper.Kernel.Types;
#endregion

public class Script_Instance : GH_ScriptInstance
{
    #region Notes
    /* 
      Members:
        RhinoDoc RhinoDocument
        GH_Document GrasshopperDocument
        IGH_Component Component
        int Iteration

      Methods (Virtual & overridable):
        Print(string text)
        Print(string format, params object[] args)
        Reflect(object obj)
        Reflect(object obj, string method_name)
    */
    #endregion

    private void RunScript(int t, object y, Transform Ts, ref object a)
    {
        // Write your logic here
        var InterB = y as ShapeInterpreter;
        var List = new List<IBlockBase>();

        for(int i = 0; i < t; i++)
        {
            List.AddRange(InterB.GetGraph().Value.Children[i].Duplicate().GetBlocks());
        }

        List.AddRange(InterB.GetGraph().Value.Children[t].Duplicate().GetBlocks().Select(x => (IBlockBase)x.Transform(Ts)));
        a = List;
    }
}
# ---------- end c_script_15 ----------
c_script_16 = CSharpScript(Inter=c_script_14.Inter, Size=Slider(37, range=0..100), Arr=Toggle(True), Sub=Toggle(True))  # -> out, a, b; inputs Size: Double, Arr: Boolean, Sub: Boolean
# ---------- c_script_16: C# ----------
// Grasshopper Script Instance
#region Usings
using System;
#r "/Volumes/File/IBOIS/Courses/TimberResearch/SLBlockResearch/Program/VScode/bin/Debug/net7.0/VScode.dll"
using System.Linq;
using System.Collections;
using System.Collections.Generic;
using System.Drawing;
using Grammar;
using Graph.Goo;
using Rhino;
using Rhino.Geometry;

using Grasshopper;
using Grasshopper.Kernel;
using Grasshopper.Kernel.Data;
using Grasshopper.Kernel.Types;
#endregion

public class Script_Instance : GH_ScriptInstance
{
    #region Notes
    /* 
      Members:
        RhinoDoc RhinoDocument
        GH_Document GrasshopperDocument
        IGH_Component Component
        int Iteration

      Methods (Virtual & overridable):
        Print(string text)
        Print(string format, params object[] args)
        Reflect(object obj)
        Reflect(object obj, string method_name)
    */
    #endregion

    private void RunScript(
		object Inter,
		double Size,
		bool Arr,
		bool Sub,
		ref object a,
		ref object b)
    {
        // Write your logic here
        var Interpret = Inter as ShapeInterpreter;
        var Graph = Interpret.GetGraph();
        if(Sub)
            Graph = new SGraphGoo(Graph.Value.GetSubNodes());
        Graph.ArrowSize = Size;
        if(Arr)
            Graph.ShowDirectedGraph = true;
        a = Graph;
    }
}
# ---------- end c_script_16 ----------
c_script_17 = CSharpScript(t=Slider(4.74, range=0..20), Inter=c_script_14.Inter)  # -> out, oBs; inputs t: Double
# ---------- c_script_17: C# ----------
// Grasshopper Script Instance
#region Usings
using System;
#r "/Volumes/File/IBOIS/Courses/TimberResearch/SLBlockResearch/Program/VScode/bin/Debug/net7.0/VScode.dll"
using System.Linq;
using System.Collections;
using System.Collections.Generic;
using System.Drawing;
using Graph;
using Grammar;
using ConstraintDOF;
using Block;
using Rhino;
using Rhino.Geometry;

using Grasshopper;
using Grasshopper.Kernel;
using Grasshopper.Kernel.Data;
using Grasshopper.Kernel.Types;
#endregion

public class Script_Instance : GH_ScriptInstance
{
    #region Notes
    /* 
      Members:
        RhinoDoc RhinoDocument
        GH_Document GrasshopperDocument
        IGH_Component Component
        int Iteration

      Methods (Virtual & overridable):
        Print(string text)
        Print(string format, params object[] args)
        Reflect(object obj)
        Reflect(object obj, string method_name)
    */
    #endregion

    private void RunScript(double t, object Inter, ref object oBs)
    {
        // Write your logic here
        if(Inter == null) return;
        var InterShape = Inter as ShapeInterpreter;
        
        oBs = InterShape.AssemblyDisplay(t, Transform.Identity);

    }
}
# ---------- end c_script_17 ----------
X = UnitX(Factor=Slider(0, range=0..10))
panel_11 = Panel(c_script_17.oBs)
panel_12 = Panel(c_script_16.a)
move_3 = Move(Motion=X)  # -> Geometry, Transform
c_script_18 = CSharpScript(x=c_script_14.Blocks, y=move_3.Transform)  # -> out, a; inputs x: list, y: Transform
# ---------- c_script_18: C# ----------
// Grasshopper Script Instance
#region Usings
#r "/Volumes/File/IBOIS/Courses/TimberResearch/SLBlockResearch/Program/VScode/bin/Debug/net7.0/VScode.dll"
using System;
using System.Linq;
using System.Collections;
using System.Collections.Generic;
using System.Drawing;
using Block;

using Rhino;
using Rhino.Geometry;

using Grasshopper;
using Grasshopper.Kernel;
using Grasshopper.Kernel.Data;
using Grasshopper.Kernel.Types;
#endregion

public class Script_Instance : GH_ScriptInstance
{
    #region Notes
    /* 
      Members:
        RhinoDoc RhinoDocument
        GH_Document GrasshopperDocument
        IGH_Component Component
        int Iteration

      Methods (Virtual & overridable):
        Print(string text)
        Print(string format, params object[] args)
        Reflect(object obj)
        Reflect(object obj, string method_name)
    */
    #endregion

    private void RunScript(List<object> x, Transform y, ref object a)
    {
        // Write your logic here
        var Group = (BlockList<IBlockBase>) x;
        Group.Transform(y);

        a = (List<IBlockBase>)Group;
    }
}
# ---------- end c_script_18 ----------
item_2 = ListItem(List=c_script_8, Index=Slider(3, range=0..5), Wrap=True)
data = Data(c_script_3.oSLBlock)
panel_13 = Panel(c_script_18.a)
transform = Transform(Geometry=data, Transform=item_2)

item_3 = ListItem(List=c_script_14.Blocks, Index=0, Wrap=True)  # -> Item, Item1, Item2
number_slider_3 = Slider(28, range=0..100)
X_2 = UnitX(Factor=Slider(4, range=0..10))
merge_2 = Merge(Data1=item_3.Item1, Data2=item_3.Item2)
merge_3 = Merge(Data1=item_3.Item, Data2=item_3.Item2)
c_script_19 = CSharpScript(ShowCon=Toggle(False), Size=number_slider_3, B1=item_3.Item, B2=item_3.Item2)  # -> out, a, b; inputs ShowCon: Boolean, Size: Double
# ---------- c_script_19: C# ----------
// Grasshopper Script Instance
#region Usings
using System;
#r "/Volumes/File/IBOIS/Courses/TimberResearch/SLBlockResearch/Program/VScode/bin/Debug/net7.0/VScode.dll"
using System.Linq;
using System.Collections;
using System.Collections.Generic;
using System.Drawing;
using Block;
using ConstraintDOF;
using ConstraintDOF.Goo;
using Graph.Goo;
using Graph;
using Rhino;
using Rhino.Geometry;

using Grasshopper;
using Grasshopper.Kernel;
using Grasshopper.Kernel.Data;
using Grasshopper.Kernel.Types;
#endregion

public class Script_Instance : GH_ScriptInstance
{
    #region Notes
    /* 
      Members:
        RhinoDoc RhinoDocument
        GH_Document GrasshopperDocument
        IGH_Component Component
        int Iteration

      Methods (Virtual & overridable):
        Print(string text)
        Print(string format, params object[] args)
        Reflect(object obj)
        Reflect(object obj, string method_name)
    */
    #endregion

    private void RunScript(
		bool ShowCon,
		double Size,
		object B1,
		object B2,
		ref object a,
		ref object b)
    {
        // Write your logic here
        var Block1 = B1 as IBlockBase;
        var Block2 = B2 as IBlockBase;
        Constraint.EvaluateDOFSingle(new SNode(Block1), new SNode(Block2), out var RefC, out var TarC);
        var ConA = new ConstraintGoo(RefC);
        ConA.ShowAllConnectingFace = ShowCon;
        ConA.Size = Size;
        a = ConA;
        b = new TestNodeGoo(TarC.Node);
    }
}
# ---------- end c_script_19 ----------
move_4 = Move(Motion=X_2)  # -> Geometry, Transform
X_3 = UnitX(Factor=Slider(0, range=-5..5))
c_script_20 = CSharpScript(ShowCon=Toggle(True), Size=number_slider_3, Bs1=merge_2, Bs2=item_3.Item)  # -> out, a, b, c; inputs ShowCon: Boolean, Size: Double, Bs1: list, Bs2: list
# ---------- c_script_20: C# ----------
// Grasshopper Script Instance
#region Usings
using System;
#r "/Volumes/File/IBOIS/Courses/TimberResearch/SLBlockResearch/Program/VScode/bin/Debug/net7.0/VScode.dll"
using System.Linq;
using System.Collections;
using System.Collections.Generic;
using System.Drawing;
using Block;
using ConstraintDOF.Goo;
using ConstraintDOF;
using Graph;
using Graph.Goo;
using Rhino;
using Rhino.Geometry;
using Graph;
using Grasshopper;
using Grasshopper.Kernel;
using Grasshopper.Kernel.Data;
using Grasshopper.Kernel.Types;
#endregion

public class Script_Instance : GH_ScriptInstance
{
    #region Notes
    /* 
      Members:
        RhinoDoc RhinoDocument
        GH_Document GrasshopperDocument
        IGH_Component Component
        int Iteration

      Methods (Virtual & overridable):
        Print(string text)
        Print(string format, params object[] args)
        Reflect(object obj)
        Reflect(object obj, string method_name)
    */
    #endregion

    private void RunScript(
		bool ShowCon,
		double Size,
		List<object> Bs1,
		List<object> Bs2,
		ref object a,
		ref object b,
		ref object c)
    {
        // Write your logic here
        var ListIBlock1 = Bs1.Select(x => new SNode(x as IBlockBase)).ToList();
        var ListIBlock2 = Bs2.Select(x => new SNode(x as IBlockBase)).ToList();

        var SGNode1 = new SGNode(0, ListIBlock1);
        var SGNode2 = new SGNode(1, ListIBlock2);

        Constraint.EvaluateDOF(SGNode1, SGNode2, out var RefConst, out var TarConst);

        var ConA = new ConstraintGoo(RefConst);
        ConA.ShowAllConnectingFace = ShowCon;
        ConA.Size = Size;

        var ConB = new ConstraintGoo(TarConst);
        ConB.ShowAllConnectingFace = ShowCon;
        ConB.Size = Size;
        
        a = ConA;
        b = ConB;
        c = new TestNodeGoo(SGNode1.Children[0]);
    }
}
# ---------- end c_script_20 ----------
rev = Reverse(Vector=X_3)
transform_2 = Transform(Geometry=c_script_19.b, Transform=move_4.Transform)
panel_14 = Panel(c_script_19.a)
move_5 = Move(Motion=rev)  # -> Geometry, Transform
move_6 = Move(Motion=X_3)  # -> Geometry, Transform
number_slider_4 = Slider(18, range=0..100)
data_2 = Data(c_script_20.c)
transform_3 = Transform(Geometry=c_script_20.b, Transform=move_5.Transform)
transform_4 = Transform(Geometry=c_script_20.a, Transform=move_6.Transform)
c_script_21 = CSharpScript(Size=number_slider_4, Block=c_script_14.Blocks)  # -> Vec; inputs Size: Double, Block: list
# ---------- c_script_21: C# ----------
// Grasshopper Script Instance
#region Usings
using System;
#r "/Volumes/File/IBOIS/Courses/TimberResearch/SLBlockResearch/Program/VScode/bin/Debug/net7.0/VScode.dll"
using System.Linq;
using System.Collections;
using System.Collections.Generic;
using System.Drawing;
using Block;
using Graph;
using Graph.Goo;
using Rhino;
using Rhino.Geometry;

using Grasshopper;
using Grasshopper.Kernel;
using Grasshopper.Kernel.Data;
using Grasshopper.Kernel.Types;
#endregion

public class Script_Instance : GH_ScriptInstance
{
    #region Notes
    /* 
      Members:
        RhinoDoc RhinoDocument
        GH_Document GrasshopperDocument
        IGH_Component Component
        int Iteration

      Methods (Virtual & overridable):
        Print(string text)
        Print(string format, params object[] args)
        Reflect(object obj)
        Reflect(object obj, string method_name)
    */
    #endregion

    private void RunScript(double Size, List<object> Block, ref object Vec)
    {
        // Write your logic here
        if(Block == null)return;
        var Bs = Block.Select(x => x as IBlockBase).ToList();
        if(Bs.Contains(null)) return;
        else
        {
            var TVec = new TestNodeGoo(Bs);
            TVec.Size = Size;
            Vec = TVec;
        }
    }
}
# ---------- end c_script_21 ----------
c_script_22 = CSharpScript(Size=number_slider_4, Block=item_3.Item)  # -> Vec; inputs Size: Double
# ---------- c_script_22: C# ----------
// Grasshopper Script Instance
#region Usings
using System;
#r "/Volumes/File/IBOIS/Courses/TimberResearch/SLBlockResearch/Program/VScode/bin/Debug/net7.0/VScode.dll"
using System.Linq;
using System.Collections;
using System.Collections.Generic;
using System.Drawing;
using Block;
using Graph;
using Graph.Goo;
using Rhino;
using Rhino.Geometry;

using Grasshopper;
using Grasshopper.Kernel;
using Grasshopper.Kernel.Data;
using Grasshopper.Kernel.Types;
#endregion

public class Script_Instance : GH_ScriptInstance
{
    #region Notes
    /* 
      Members:
        RhinoDoc RhinoDocument
        GH_Document GrasshopperDocument
        IGH_Component Component
        int Iteration

      Methods (Virtual & overridable):
        Print(string text)
        Print(string format, params object[] args)
        Reflect(object obj)
        Reflect(object obj, string method_name)
    */
    #endregion

    private void RunScript(double Size, object Block, ref object Vec)
    {
        // Write your logic here
        var B = Block as IBlockBase;
        if(B == null) return;
        else
        {
            var TVec = new TestNodeGoo(B);
            TVec.Size = Size;
            Vec = TVec;
        }
    }
}
# ---------- end c_script_22 ----------

item_4 = ListItem(List=c_script_14.Blocks, Index=0, Wrap=True)  # -> Item, Item1, Item2, Item3, Item4, Item5, Item6, Item7, Item8
merge_4 = Merge(Data1=item_4.Item5, Data2=item_4.Item6, Data3=item_4.Item7, Data4=item_4.Item8)
merge_5 = Merge(Data1=item_4.Item, Data2=item_4.Item1, Data3=item_4.Item2, Data4=item_4.Item3, Data5=item_4.Item4)
c_script_23 = CSharpScript(ShowCon=Toggle(False), Index=Slider(-1, range=-1..8), Size=number_slider_3, Bs1=merge_5, Bs2=merge_4)  # -> out, a, b, c; inputs ShowCon: Boolean, Index: Int32, Size: Double, Bs1: list, Bs2: list
# ---------- c_script_23: C# ----------
// Grasshopper Script Instance
#region Usings
using System;
#r "/Volumes/File/IBOIS/Courses/TimberResearch/SLBlockResearch/Program/VScode/bin/Debug/net7.0/VScode.dll"
using System.Linq;
using System.Collections;
using System.Collections.Generic;
using System.Drawing;
using Block;
using ConstraintDOF.Goo;
using ConstraintDOF;
using Graph;
using Graph.Goo;
using Rhino;
using Rhino.Geometry;
using Graph;
using Grasshopper;
using Grasshopper.Kernel;
using Grasshopper.Kernel.Data;
using Grasshopper.Kernel.Types;
#endregion

public class Script_Instance : GH_ScriptInstance
{
    #region Notes
    /* 
      Members:
        RhinoDoc RhinoDocument
        GH_Document GrasshopperDocument
        IGH_Component Component
        int Iteration

      Methods (Virtual & overridable):
        Print(string text)
        Print(string format, params object[] args)
        Reflect(object obj)
        Reflect(object obj, string method_name)
    */
    #endregion

    private void RunScript(
		bool ShowCon,
		int Index,
		double Size,
		List<object> Bs1,
		List<object> Bs2,
		ref object a,
		ref object b,
		ref object c)
    {
        if(Bs1 == null || Bs2 == null) return;
        // Write your logic here
        var ListIBlock1 = Bs1.Select(x => new SNode(x as IBlockBase)).ToList();
        var ListIBlock2 = Bs2.Select(x => new SNode(x as IBlockBase)).ToList();

        var SGNode1 = new SGNode(0, ListIBlock1);
        var SGNode2 = new SGNode(1, ListIBlock2);

        Constraint.EvaluateDOF(SGNode1, SGNode2, out var RefConst, out var TarConst);

        var ConA = new ConstraintGoo(RefConst);
        ConA.ShowAllConnectingFace = ShowCon;
        ConA.Size = Size;

        var ConB = new ConstraintGoo(TarConst);
        ConB.ShowAllConnectingFace = ShowCon;
        ConB.Size = Size;
        var ChildrenConst = new List<Constraint>();
        if(Index == -1)
            TarConst.GetAllElementsConstraint(1, out _, out ChildrenConst);
        else
        {
            var ChildConst = TarConst.GetElementConstraint(Index, out _);
            ChildrenConst.Add(ChildConst);
        }
        var ChildrenConstGoo = ChildrenConst.Select(x => {
            var Const = new ConstraintGoo(x); 
        Const.Size = Size; Const.ShowAllConnectingFace = ShowCon; 
        return Const;
        }).ToList();
        a = ConA;
        b = ConB;
        c = ChildrenConstGoo;
    }
}
# ---------- end c_script_23 ----------
X_4 = UnitX(Factor=Slider(0, range=-5..5))
rev_2 = Reverse(Vector=X_4)
move_7 = Move(Motion=rev_2)  # -> Geometry, Transform
move_8 = Move(Motion=X_4)  # -> Geometry, Transform
transform_5 = Transform(Geometry=c_script_23.b, Transform=move_7.Transform)
transform_6 = Transform(Geometry=c_script_23.a, Transform=move_8.Transform)
data_3 = Data(c_script_23.c)

merge_6 = Merge(
    Data1=item_4.Item,
    Data2=item_4.Item1,
    Data3=item_4.Item2,
    Data4=item_4.Item3,
    Data5=item_4.Item4,
    Data6=item_4.Item5,
    Data7=item_4.Item6,
    Data8=item_4.Item7,
    Data9=item_4.Item8)
item_5 = ListItem(List=c_script_14.Blocks, Index=Slider(4, range=0..10), Wrap=True)
merge_7 = Merge(Data1=item_4.Item1, Data2=item_4.Item2, Data3=item_4.Item5, Data4=item_4.Item6)
merge_8 = Merge(Data1=item_4.Item1, Data2=item_4.Item2)
panel_15 = Panel(c_script_14.Blocks)
c_script_24 = CSharpScript(Col=ColourSwatch(SwatchColor=RGB(92, 1, 1)))  # inputs Col: Color
# ---------- c_script_24: C# ----------
// Grasshopper Script Instance
#region Usings
#r "/Volumes/File/IBOIS/Courses/TimberResearch/SLBlockResearch/Program/VScode/bin/Debug/net7.0/VScode.dll"
using System;
using System.Linq;
using System.Collections;
using System.Collections.Generic;
using System.Drawing;
using Block;

using Rhino;
using Rhino.Geometry;

using Grasshopper;
using Grasshopper.Kernel;
using Grasshopper.Kernel.Data;
using Grasshopper.Kernel.Types;
#endregion

public class Script_Instance : GH_ScriptInstance
{
    #region Notes
    /* 
      Members:
        RhinoDoc RhinoDocument
        GH_Document GrasshopperDocument
        IGH_Component Component
        int Iteration

      Methods (Virtual & overridable):
        Print(string text)
        Print(string format, params object[] args)
        Reflect(object obj)
        Reflect(object obj, string method_name)
    */
    #endregion

    private void RunScript(object iSL, Color Col)
    {
        // Write your logic here
        if(iSL == null) return;
        var SL = (IBlockBase) iSL;
        SL.attribute.BlockColor = Col;

    }
}
# ---------- end c_script_24 ----------
panel_16 = Panel("Smaller => Stabler")
c_script_25 = CSharpScript(ShowCon=Toggle(False), Size=Slider(51, range=0..100), BLs=merge_7)  # -> out, a; inputs ShowCon: Boolean, Size: Int32, BLs: list
# ---------- c_script_25: C# ----------
// Grasshopper Script Instance
#region Usings
#r "/Volumes/File/IBOIS/Courses/TimberResearch/SLBlockResearch/Program/VScode/bin/Debug/net7.0/VScode.dll"

using System;
using System.Linq;
using System.Collections;
using System.Collections.Generic;
using System.Drawing;
using Block;
using Graph;
using Graph.Goo;
using ConstraintDOF;
using ConstraintDOF.Goo;
using Rhino;
using Rhino.Geometry;

using Grasshopper;
using Grasshopper.Kernel;
using Grasshopper.Kernel.Data;
using Grasshopper.Kernel.Types;
#endregion

public class Script_Instance : GH_ScriptInstance
{
    #region Notes
    /* 
      Members:
        RhinoDoc RhinoDocument
        GH_Document GrasshopperDocument
        IGH_Component Component
        int Iteration

      Methods (Virtual & overridable):
        Print(string text)
        Print(string format, params object[] args)
        Reflect(object obj)
        Reflect(object obj, string method_name)
    */
    #endregion

    private void RunScript(bool ShowCon, int Size, List<object> BLs, ref object a)
    {
        if(BLs == null ||Size <=0) return;
        
        var SGNode = new SGNode(0, BLs.Select(x => new SNode((IBlockBase)x)));
        Constraint.EvaluateSGNodeDOFVecters(SGNode, out var CNodes, out var CConst);
        var CConstGoo = CConst.Select(x => new ConstraintGoo(x)).Select(x => {x.Size = Size; return x;}).ToList();

            foreach(var Constr in CConstGoo)
            {
                Constr.ShowAllConnectingFace = ShowCon;
            }
        
        // Write your logic here
        a = CConstGoo;
    }
}
# ---------- end c_script_25 ----------
c_script_26 = CSharpScript(Bs=merge_5, NeedPlane=Toggle(True))  # -> out, Val; inputs Bs: list, NeedPlane: Boolean
# ---------- c_script_26: C# ----------
// Grasshopper Script Instance
#region Usings
using System;
#r "/Volumes/File/IBOIS/Courses/TimberResearch/SLBlockResearch/Program/VScode/bin/Debug/net7.0/VScode.dll"
using System.Linq;
using System.Collections;
using System.Collections.Generic;
using System.Drawing;

using Graph;
using Block;
using ConstraintDOF;

using Rhino;
using Rhino.Geometry;

using Grasshopper;
using Grasshopper.Kernel;
using Grasshopper.Kernel.Data;
using Grasshopper.Kernel.Types;
#endregion

public class Script_Instance : GH_ScriptInstance
{
    #region Notes
    /* 
      Members:
        RhinoDoc RhinoDocument
        GH_Document GrasshopperDocument
        IGH_Component Component
        int Iteration

      Methods (Virtual & overridable):
        Print(string text)
        Print(string format, params object[] args)
        Reflect(object obj)
        Reflect(object obj, string method_name)
    */
    #endregion

    private void RunScript(List<object> Bs, bool NeedPlane, ref object Val)
    {
        if(Bs == null) return;
        // Write your logic here

        var BLocks = Bs.Select(x => new SNode((IBlockBase) x));
        var aSGNode = new SGNode(-1, BLocks);

        Val = Constraint.EvaStability(aSGNode, NeedPlane);
    }
}
# ---------- end c_script_26 ----------
c_script_27 = CSharpScript(ShowCon=Toggle(True), Size=Slider(83, range=0..100), BLs=merge_5)  # -> out, a; inputs ShowCon: Boolean, Size: Int32, BLs: list; same code as c_script_25
panel_17 = Panel(c_script_27.a)
panel_18 = Panel(c_script_26.Val)
