# Grasshopper definition custom goo.gh (Grasshopper 1.0.8)

Z = UnitZ(Factor=Slider(15, range=0..100))
move = Move(Motion=Z)  # -> Geometry, Transform
rotate = Rotate(Angle=degrees(Slider(18, range=0..100)), Plane=PlaneXY(0, 0, 0))  # -> Geometry, Transform
pt = Point([Point(-0.68572456, 7.029965646, 0), Point(-9.9940628, 7.238126488, 0), Point(-10.40410884, -8.252247272, 0), Point(-0.2694724902, -18.94613933, 0), Point(10.84674449, -14.02622914, 0), Point(10.69156611, -4.456809061, 0), Point(5.987472374, 5.301980723, 0)])
move_2 = Move(Geometry=pt, Motion=Vector(0, 0, 2))  # -> Geometry, Transform
c_script = CSharpScript(x=rotate.Transform, y=move.Transform)  # -> out, a; inputs x: Transform, y: Transform
# ---------- c_script: C# ----------
// Grasshopper Script Instance
#region Usings
using System;
using System.Linq;
using System.Collections;
using System.Collections.Generic;
using System.Drawing;

using Rhino;
using Rhino.Geometry;

using Grasshopper;
using Grasshopper.Kernel;
using Grasshopper.Kernel.Data;
using Grasshopper.Kernel.Types;
#endregion

public class Script_Instance : GH_ScriptInstance
{
    #region Notes
    /* 
      Members:
        RhinoDoc RhinoDocument
        GH_Document GrasshopperDocument
        IGH_Component Component
        int Iteration

      Methods (Virtual & overridable):
        Print(string text)
        Print(string format, params object[] args)
        Reflect(object obj)
        Reflect(object obj, string method_name)
    */
    #endregion

    private void RunScript(Transform x, Transform y, ref object a)
    {
        var SL = new SLBlock(4);
        SL.Transform(x);
        SL.Transform(y);
        a = SL;
    }

 public enum PairOption
    {
        Top,
        Bottom,
        Chain
    }
    public class SLBlockPair : GH_GeometricGoo<Point3d>, IGH_PreviewData
    {
        #region Property
        public Transform XForm { get; private set; }
        public double Size { get; }
        private List<Transform> _transforms;
        #endregion Property
        ///<summary>
        /// Accesses a specific voxel within the SLBlock by its index.
        ///</summary>
        ///<param name="index">Index of the voxel to access.</param>
        ///<returns>The voxel at the specified index.</returns>
        public Voxel this[int index]
        {
            get
            {
                if (index < 0 || index >= _transforms.Count)
                    throw new IndexOutOfRangeException();

                var T = _transforms[index];
                var V = new Voxel(this.Size);
                V.Transform(T);
                return V;
            }
            set
            {
                _transforms[index] = value.Xform;
            }
        }
        public SLBlockPair(double Size)
        {
            this.Size = Size;
            this.XForm = Rhino.Geometry.Transform.Identity;
            _transforms = new List<Transform>();
            var VoxelLoc = new List<Vector3d>{
                new Vector3d(-Size * 3 / 2, -Size / 2, -Size / 2),
                new Vector3d(-Size * 3 / 2, -Size / 2, -Size*3 / 2),
                new Vector3d(-Size / 2, -Size / 2, 3*-Size / 2),
                new Vector3d(Size / 2, -Size / 2, -Size * 3 / 2),
                new Vector3d(Size / 2, Size / 2, -Size *3 / 2),
                new Vector3d(Size / 2, Size / 2,-Size / 2),
                new Vector3d(Size * 3 / 2, Size / 2, -Size / 2),
                new Vector3d(Size * 3 / 2, Size / 2, Size / 2)
            };
            var Translation = VoxelLoc.Select(x => Rhino.Geometry.Transform.Translation(x)).ToList();
            _transforms.AddRange(Translation.Select(x => new Transform(x)));
            Translation = Translation.Select(x => Rhino.Geometry.Transform.Rotation(Math.PI, Vector3d.YAxis, Point3d.Origin) * x).ToList();
            _transforms.AddRange(Translation);
        }
        public SLBlockPair(SLBlock block)
        {
            this.Size = block.Size;
            this.XForm = block.XForm;
            this._transforms = new List<Transform>();
            var VoxelLoc = new List<Vector3d>{
                new Vector3d(-Size * 3 / 2, -Size / 2, -Size / 2),
                new Vector3d(-Size * 3 / 2, -Size / 2, -Size*3 / 2),
                new Vector3d(-Size / 2, -Size / 2, 3*-Size / 2),
                new Vector3d(Size / 2, -Size / 2, -Size * 3 / 2),
                new Vector3d(Size / 2, Size / 2, -Size *3 / 2),
                new Vector3d(Size / 2, Size / 2,-Size / 2),
                new Vector3d(Size * 3 / 2, Size / 2, -Size / 2),
                new Vector3d(Size * 3 / 2, Size / 2, Size / 2)
            };
            var Translation = VoxelLoc.Select(x => Rhino.Geometry.Transform.Translation(x)).ToList();
            _transforms.AddRange(Translation.Select(x => new Transform(x)));
            Translation = Translation.Select(x => Rhino.Geometry.Transform.Rotation(Math.PI, Vector3d.YAxis, Point3d.Origin) * x).ToList();
            _transforms.AddRange(Translation);
        }

        public SLBlockPair DuplicateSLBlockPair()
        {
            var NewSL = new SLBlockPair(this.Size);
            NewSL.XForm = this.XForm;
            return NewSL;
        }
        private List<Transform> GetTransforms(PairOption option = PairOption.Chain)
        {
            switch (option)
            {
                case PairOption.Chain:
                    return this._transforms;
                case PairOption.Top:
                    return this._transforms.GetRange(8, 8);
                case PairOption.Bottom:
                    return this._transforms.GetRange(0, 8);
            }
            return null;
        }
        #region GetGeometry
        public List<Box> GetSLBLock(PairOption options = PairOption.Chain)
        {
            var Voxel = new Voxel(Size);
            var Boxes = GetTransforms(options).Select(t =>
                    {
                        var V = Voxel.DuplicateVoxel();
                        V.Transform(XForm);
                        V.Transform(t);
                        return V.VoxelDisplay();
                    }
                    ).ToList();
            return Boxes;
        }
        public List<Point3d> GetSLBlockGraphNode(PairOption options = PairOption.Chain)
        {
            return GetTransforms(options).Select(t =>
            {
                var Pt = Point3d.Origin;
                Pt.Transform(t);
                Pt.Transform(XForm);
                return Pt;
            }).ToList();
        }
        public List<Curve> GetSLBlockGraphEdge(PairOption option = PairOption.Chain)
        {
            if (option == PairOption.Chain)
            {
                var NodesBot = this.GetSLBlockGraphNode(PairOption.Bottom);
                var NodesTop = this.GetSLBlockGraphNode(PairOption.Top);
                var Edge = new PolylineCurve(NodesBot).DuplicateSegments().ToList();
                Edge.AddRange(new PolylineCurve(NodesTop).DuplicateSegments());
                return Edge;

            }
            else
            {
                var Nodes = this.GetSLBlockGraphNode(option);
                return new PolylineCurve(Nodes).DuplicateSegments().ToList();
            }
        }
        #endregion GetGeometry

        public override string ToString()
        {
            var Location = Point3d.Origin;
            Location.Transform(this.XForm);
            return $"SLBlockPair \n Location : {Location.ToString()}, Size : {Size}";
        }

        public override string TypeName => "SLBlockPair";
        public override string TypeDescription => "A pair of SLBlocks with optional bottom/top/chain configuration.";

        public override BoundingBox Boundingbox
        {
            get
            {
                BoundingBox box = BoundingBox.Empty;
                foreach (var b in this.GetSLBLock())
                    box.Union(b.BoundingBox);
                return box;
            }
        }

        public BoundingBox ClippingBox => this.Boundingbox;
        public override BoundingBox GetBoundingBox(Transform xform)
        {
            var boxes = this.GetSLBLock();
            BoundingBox box = BoundingBox.Empty;
            foreach (var b in boxes)
            {
                var transformedBox = new Box(b);
                transformedBox.Transform(xform);
                box.Union(transformedBox.BoundingBox);
            }
            return box;
        }
        public override IGH_GeometricGoo DuplicateGeometry()
        {
            return this.DuplicateSLBlockPair();
        }

        public override IGH_GeometricGoo Transform(Transform xform)
        {
            this.XForm *= xform;
            return this;
        }

        public override IGH_GeometricGoo Morph(SpaceMorph xmorph)
        {
            var points = this.GetSLBlockGraphNode().Select(p => xmorph.MorphPoint(p)).ToList();
            var copy = new SLBlockPair(this.Size);
            copy._transforms = points.Select(p => Rhino.Geometry.Transform.Translation(new Vector3d(p))).ToList();
            return copy;
        }

        public override bool CastFrom(object source)
        {
            if (source == null) return false;

            if (source is Point3d pt)
            {
                this.XForm = Rhino.Geometry.Transform.Translation(new Vector3d(pt));
                Value = (Point3d) source;
                return true;
            }

            if (source is GH_Point ghPt)
            {
                this.XForm = Rhino.Geometry.Transform.Translation(new Vector3d(ghPt.Value));
                Value = (Point3d) source;
                return true;
            }

            Point3d point = Point3d.Unset;
            if (GH_Convert.ToPoint3d(source, ref point, GH_Conversion.Both))
            {
                this.XForm = Rhino.Geometry.Transform.Translation(new Vector3d(point));
                Value = (Point3d) source;
                return true;
            }

            return false;
        }

        public void DrawViewportWires(GH_PreviewWireArgs args)
        {
            foreach (var Pt in this.GetSLBlockGraphNode())
                args.Pipeline.DrawPoint(Pt, args.Color);
            
            var PL = Plane.WorldXY; PL.Transform(this.XForm);
            args.Pipeline.DrawPoint(PL.Origin, Rhino.Display.PointStyle.Pin, 3, Color.Blue);
            
            args.Pipeline.DrawArrow(new Line(PL.Origin, PL.Origin + PL.XAxis * 0.2*Size), Color.Red);
            args.Pipeline.DrawArrow(new Line(PL.Origin, PL.Origin + PL.YAxis * 0.2*Size), Color.Green);
            args.Pipeline.DrawArrow(new Line(PL.Origin, PL.Origin + PL.ZAxis * 0.2*Size), Color.Yellow);

            foreach (var Crv in this.GetSLBlockGraphEdge())
            {
                args.Pipeline.DrawCurve(Crv, args.Color, 4);
            }
        }

        public void DrawViewportMeshes(GH_PreviewMeshArgs args)
        {
            foreach (var b in this.GetSLBLock(PairOption.Top))
            {
                var mesh = Mesh.CreateFromBox(b, 2, 2, 2);
                var material = new Rhino.Display.DisplayMaterial(System.Drawing.Color.Yellow, 0.8);
                args.Pipeline.DrawMeshShaded(mesh, material);
            }
            foreach (var b in this.GetSLBLock(PairOption.Bottom))
            {
                var mesh = Mesh.CreateFromBox(b, 2, 2, 2);
                var material = new Rhino.Display.DisplayMaterial(System.Drawing.Color.Blue, 0.8);
                args.Pipeline.DrawMeshShaded(mesh, material);
            }
        }

        //Override
        public override object ScriptVariable()
        {
            return Value;
        }
        public override Point3d Value {get {
            var Pt = Point3d.Origin;
            Pt.Transform(XForm);
            return Pt;
        } set 
        {
            this.XForm = Rhino.Geometry.Transform.Translation(new Vector3d(value));
        }}
        public override bool CastTo<TQ>(out TQ target)
        {
            if (typeof(TQ).IsAssignableFrom(typeof(Point3d)))
            {
                Value.Transform(this.XForm);
                target = (TQ)(object)Value;
                return true;
            }

            if (typeof(TQ).IsAssignableFrom(typeof(GH_Point)))
            {
                Value.Transform(this.XForm);
                target = (TQ)(object)new GH_Point(Value);
                return true;
            }

            target = default(TQ);
            return false;
        }
    }



 public class SLBlock : GH_GeometricGoo<Point3d>, IGH_PreviewData
    {

        #region Property
        ///<summary>
        /// Gets or sets the transformation matrix applied to the SLBlock.
        ///</summary>
        public Transform XForm { get; private set; }

        ///<summary>
        /// The size dimension of each voxel within the SLBlock.
        ///</summary>
        public double Size { get; }
        ///<summary>
        /// The transformation for the voxel blocks
        ///</summary>
        ///<param name="_transforms">transformation forms the SL block.</param>
        ///<returns>The transformation matrix list.</returns>

        private List<Transform> _transforms;
        #endregion Property
        ///<summary>
        /// Accesses a specific voxel within the SLBlock by its index.
        ///</summary>
        ///<param name="index">Index of the voxel to access.</param>
        ///<returns>The voxel at the specified index.</returns>
        public Voxel this[int index]
        {
            get
            {
                if (index < 0 || index >= _transforms.Count)
                    throw new IndexOutOfRangeException();

                var T = _transforms[index];
                var V = new Voxel(this.Size);
                V.Transform(T);
                return V;
            }
            set
            {
                _transforms[index] = value.Xform;
            }
        }

        public SLBlock(double Size = 1)
        {
            this.Size = Size;
            _transforms = new List<Transform>();
            var VoxelLoc = new List<Vector3d>{
                new Vector3d(-Size * 3 / 2, -Size / 2, -Size / 2),
                new Vector3d(-Size * 3 / 2, -Size / 2, -Size*3 / 2),
                new Vector3d(-Size / 2, -Size / 2, 3*-Size / 2),
                new Vector3d(Size / 2, -Size / 2, -Size * 3 / 2),
                new Vector3d(Size / 2, Size / 2, -Size *3 / 2),
                new Vector3d(Size / 2, Size / 2,-Size / 2),
                new Vector3d(Size * 3 / 2, Size / 2, -Size / 2),
                new Vector3d(Size * 3 / 2, Size / 2, Size / 2)
            };
            this.XForm = Rhino.Geometry.Transform.Identity;
            _transforms.AddRange(VoxelLoc.Select(x => Rhino.Geometry.Transform.Translation(x)));
        }
        public SLBlock DuplicateSLBlock()
        {
            var NewSL = new SLBlock(this.Size);
            NewSL.XForm = this.XForm;
            return NewSL;
        }


        #region GetGeometry
        public List<Box> GetSLBlock()
        {
            var Voxel = new Voxel(Size);
            var Boxes = this._transforms.Select(t =>
            {
                var V = Voxel.DuplicateVoxel();
                V.Transform(XForm);
                V.Transform(t);
                return V.VoxelDisplay();
            }
            );

            return Boxes.ToList();
        }
        public List<Point3d> GetSLBlockGraphNode()
        {

            var Nodes = this._transforms.Select(t =>
            {
                var Pt = Point3d.Origin;
                Pt.Transform(t);
                Pt.Transform(XForm);
                return Pt;
            });
            return Nodes.ToList();
        }
        public List<Curve> GetSLBlockGraphEdge()
        {
            var Nodes = this.GetSLBlockGraphNode();
            var PolyCrv = new PolylineCurve(Nodes);
            return PolyCrv.DuplicateSegments().ToList();
        }
        #endregion GetGeometry

        public override string ToString()
        {
            var Location = Point3d.Origin;
            Location.Transform(this.XForm);
            return $"SLBlock \n Location : {Location.ToString()}, Size : {Size}";
        }
        public override string TypeName => "SLBlock";
        public override IGH_GeometricGoo DuplicateGeometry()
        {
            return this.DuplicateSLBlock();
        }
        public override BoundingBox Boundingbox
        {
            get
            {
                var boxes = this.GetSLBlock();
                BoundingBox box = BoundingBox.Empty;
                foreach (var b in boxes)
                    box.Union(b.BoundingBox);
                return box;
            }
        }

        public BoundingBox ClippingBox => this.Boundingbox;
        public override string TypeDescription => this.ToString();

        public override BoundingBox GetBoundingBox(Transform xform)
        {
            var boxes = this.GetSLBlock();
            BoundingBox box = BoundingBox.Empty;
            foreach (var b in boxes)
            {
                var transformedBox = new Box(b);
                transformedBox.Transform(xform);
                box.Union(transformedBox.BoundingBox);
            }
            return box;
        }
        public override IGH_GeometricGoo Transform(Transform xform)
        {
            this.XForm *= xform;
            return this;
        }
        public override IGH_GeometricGoo Morph(SpaceMorph xmorph)
        {
            var nodes = this.GetSLBlockGraphNode().Select(xmorph.MorphPoint).ToList();
            var newBlock = new SLBlock(this.Size);
            newBlock._transforms = nodes.Select(p => Rhino.Geometry.Transform.Translation(new Vector3d(p))).ToList();
            return newBlock;
        }
        public override bool CastFrom(object source)
        {
            if (source == null) return false;

            if (source is Point3d pt)
            {
                this.XForm = Rhino.Geometry.Transform.Translation(new Vector3d(pt));
                return true;
            }

            if (source is GH_Point ghPt)
            {
                this.XForm = Rhino.Geometry.Transform.Translation(new Vector3d(ghPt.Value));
                return true;
            }

            Point3d point = Point3d.Unset;
            if (GH_Convert.ToPoint3d(source, ref point, GH_Conversion.Both))
            {
                this.XForm = Rhino.Geometry.Transform.Translation(new Vector3d(point));
                return true;
            }

            return false;
        }
        #region Preview
        public void DrawViewportWires(GH_PreviewWireArgs args)
        {
            foreach (var Pt in this.GetSLBlockGraphNode())
                args.Pipeline.DrawPoint(Pt, args.Color);

            var PL = Plane.WorldXY; PL.Transform(this.XForm);
            args.Pipeline.DrawPoint(PL.Origin, Rhino.Display.PointStyle.Pin, 3, Color.Blue);

            args.Pipeline.DrawArrow(new Line(PL.Origin, PL.Origin + PL.XAxis * 0.2 * Size), Color.Red);
            args.Pipeline.DrawArrow(new Line(PL.Origin, PL.Origin + PL.YAxis * 0.2 * Size), Color.Green);
            args.Pipeline.DrawArrow(new Line(PL.Origin, PL.Origin + PL.ZAxis * 0.2 * Size), Color.Yellow);

            foreach (var Crv in this.GetSLBlockGraphEdge())
            {
                args.Pipeline.DrawCurve(Crv, args.Color, 4);
            }
        }

        public void DrawViewportMeshes(GH_PreviewMeshArgs args)
        {
            foreach (var b in this.GetSLBlock())
            {
                var mesh = Mesh.CreateFromBox(b, 2, 2, 2);
                var Display = new Rhino.Display.DisplayMaterial(Color.Green, 0.8);
                args.Pipeline.DrawMeshShaded(mesh, Display);

            }
        }
        #endregion Preview
        public override object ScriptVariable()
        {
            return Value;
        }
        public override Point3d Value
        {
            get
            {
                var Pt = Point3d.Origin;
                Pt.Transform(XForm);
                return Pt;
            }
            set
            {
                this.XForm = Rhino.Geometry.Transform.Translation(new Vector3d(value));
            }
        }
        public override bool CastTo<TQ>(out TQ target)
        {
            if (typeof(TQ).IsAssignableFrom(typeof(Point3d)))
            {
                Value.Transform(this.XForm);
                target = (TQ)(object)Value;
                return true;
            }

            if (typeof(TQ).IsAssignableFrom(typeof(GH_Point)))
            {
                Value.Transform(this.XForm);
                target = (TQ)(object)new GH_Point(Value);
                return true;
            }

            target = default(TQ);
            return false;
        }

    }
}




    public class Voxel
    {
        //Property
        public Transform Xform;
        public double Size;

        //Function
        public Box VoxelDisplay() 
        {
            var B = new Box(
            Plane.WorldXY,
            new Interval(-Size/2, Size/2),
            new Interval(-Size/2, Size/2),
            new Interval(-Size/2, Size/2)
            );
            B.Transform (Xform);
            return B;
        }
        public Voxel(double Size)
        {
            this.Size = Size;
            this.Xform = Rhino.Geometry.Transform.Identity ;
        }
        public Voxel(Voxel V) 
        {
            this.Size = V.Size;
            this.Xform = V.Xform;
        }
        public void Transform(Transform T)
        {   
            this.Xform *= T;
        }
        public Voxel DuplicateVoxel() => new Voxel(this);
        public override bool Equals(object obj)
        {
            if(obj is Voxel V)
            {
                return this.Xform.Equals(V.Xform) && this.Size == V.Size;
            }
            else return false;
        }
        public override int GetHashCode() => base.GetHashCode();
    }
# ---------- end c_script ----------
c_script_2 = CSharpScript(P=move_2.Geometry)  # -> out, M; inputs P: Point3d
# ---------- c_script_2: C# ----------
    M = new CustomPoint(P);
# ---------- c_script_2: C# additional code ----------
  public class CustomPoint : GH_GeometricGoo<Point3d>, IGH_PreviewData
  {
    public CustomPoint(Point3d point)
    : base(point) { }

    public override string ToString()
    {
      return string.Format("Custom: {0:0.0},{1:0.0},{2:0.0}", Value.X, Value.Y, Value.Z);
    }
    public override string TypeName
    {
      get { return "Custom Point"; }
    }
    public override string TypeDescription
    {
      get { return "A custom point type."; }
    }

    public override IGH_GeometricGoo DuplicateGeometry()
    {
      return new CustomPoint(Value);
    }
    public override BoundingBox Boundingbox
    {
      get
      {
        BoundingBox box = new BoundingBox(Value, Value);
        box.Inflate(1);
        return box;
      }
    }
    public override BoundingBox GetBoundingBox(Transform xform)
    {
      Point3d point = Value;
      point.Transform(xform);
      BoundingBox box = new BoundingBox(point, point);
      box.Inflate(1);
      return box;
    }
    public override IGH_GeometricGoo Transform(Transform xform)
    {
      Point3d point = Value;
      point.Transform(xform);
      return new CustomPoint(point);
    }
    public override IGH_GeometricGoo Morph(SpaceMorph xmorph)
    {
      Point3d point = xmorph.MorphPoint(Value);
      return new CustomPoint(point);
    }

    public override object ScriptVariable()
    {
      return Value;
    }
    public override bool CastTo<TQ>(out TQ target)
    {
    if (typeof(TQ).IsAssignableFrom(typeof(Point3d)))
    {
      target = (TQ) (object) Value;
      return true;
    }

    if (typeof(TQ).IsAssignableFrom(typeof(GH_Point)))
    {
      target = (TQ) (object) new GH_Point(Value);
      return true;
    }

    target = default(TQ);
    return false;
  }
  public override bool CastFrom(object source)
  {
    if (source == null) return false;
    if (source is Point3d)
    {
      Value = (Point3d) source;
      return true;
    }
    GH_Point pointGoo = source as GH_Point;
    if (pointGoo != null)
    {
      Value = pointGoo.Value;
      return true;
    }

    Point3d point = Point3d.Unset;
    if (GH_Convert.ToPoint3d(source, ref point, GH_Conversion.Both))
    {
      Value = point;
      return true;
    }

    return false;
  }

  public BoundingBox ClippingBox
  {
    get { return Boundingbox; }
  }
  public void DrawViewportWires(GH_PreviewWireArgs args)
  {
    args.Pipeline.DrawPoint(Value, args.Color);
    if (Value != Point3d.Origin)
    {
      Vector3d axis = new Vector3d(Value);
      axis.Unitize();
      Plane plane = new Plane(Value, -axis);
      Circle circle = new Circle(plane, 1);
      args.Pipeline.DrawCircle(circle, args.Color);
    }
  }
  public void DrawViewportMeshes(GH_PreviewMeshArgs args) { }
}
# ---------- end c_script_2 ----------
panel = Panel(c_script_2.M)
panel_2 = Panel(c_script.a)
